# Grasshopper definition 00_GH_Reaction-Diffusion.gh (Grasshopper 1.0.8)

trigger = Trigger(Interval=100, TimerInterval=100, Target=reaction_diffusion_animation)  # disabled
trigger_2 = Trigger(Interval=100, TimerInterval=100, Target=reaction_diffusion_animation_2)  # disabled
reaction_diffusion = Python3Script(
    N0="100",
    Steps="300",
    dt="0.1",
    Lx="10.0",
    Ly="10.0",
    Lz="5.0",
    speed="0.2",
    noise="0.05",
    repulsion_strength="0.1",
    division_radius="0.1",
    division_rate="0.01")  # -> out, FinalPoints, Trajectories, Info; inputs N0: Int32, Steps: Int32, dt: Double, Lx: Double, Ly: Double, Lz: Double, speed: Double, noise: Double, repulsion_strength: Double, division_radius: Double, division_rate: Double
# ---------- reaction_diffusion: Python ----------
import random
import Rhino.Geometry as rg
import System
from System import Array
from math import sqrt
import clr
import traceback
import math


# =======================================================
# Cell Class
# =======================================================
class Cell:
    def __init__(self, pos):
        self.pos = pos  # (x,y,z)
        self.history = [pos]  # trajectory tracking


# =======================================================
# Utility: repulsion force (simple)
# =======================================================
def repulsion(cells, idx, strength, min_dist=0.1):
    cx, cy, cz = cells[idx].pos
    fx, fy, fz = 0.0, 0.0, 0.0

    for j in range(len(cells)):
        if j == idx: 
            continue

        x, y, z = cells[j].pos
        dx = cx - x
        dy = cy - y
        dz = cz - z

        dist = sqrt(dx*dx + dy*dy + dz*dz)
        if dist < min_dist and dist > 1e-6:
            factor = strength * (1.0/dist - 1.0/min_dist)
            fx += factor * (dx/dist)
            fy += factor * (dy/dist)
            fz += factor * (dz/dist)

    return fx, fy, fz


# =======================================================
# Main Simulation
# =======================================================
def simulate(
    N0=50,
    Steps=200,
    dt=0.1,
    Lx=10.0, Ly=10.0, Lz=5.0,
    speed=0.2,
    noise=0.05,
    repulsion_strength=0.1,
    division_rate=0.01,
    division_radius=0.1
):
    # Initialize cells
    cells = []
    for i in range(N0):
        x = random.random()*Lx
        y = random.random()*Ly
        z = random.random()*Lz
        cells.append(Cell((x,y,z)))

    # Simulation
    for step in range(Steps):
        new_cells = []

        for i in range(len(cells)):
            cx, cy, cz = cells[i].pos

            # random motility
            vx = (random.random()-0.5) * speed
            vy = (random.random()-0.5) * speed
            vz = (random.random()-0.5) * speed

            # Brownian noise
            vx += noise*(random.random()-0.5)
            vy += noise*(random.random()-0.5)
            vz += noise*(random.random()-0.5)

            # repulsion
            rx, ry, rz = repulsion(cells, i, repulsion_strength)
            vx += rx
            vy += ry
            vz += rz

            # update position
            nx = cx + vx*dt
            ny = cy + vy*dt
            nz = cz + vz*dt

            # reflect on boundaries
            nx = max(0, min(Lx, nx))
            ny = max(0, min(Ly, ny))
            nz = max(0, min(Lz, nz))

            cells[i].pos = (nx, ny, nz)
            cells[i].history.append((nx, ny, nz))

            # cell division
            if random.random() < division_rate:
                # new cell near parent
                bx = nx + division_radius*(random.random()-0.5)
                by = ny + division_radius*(random.random()-0.5)
                bz = nz + division_radius*(random.random()-0.5)

                bx = max(0, min(Lx, bx))
                by = max(0, min(Ly, by))
                bz = max(0, min(Lz, bz))

                new_cells.append(Cell((bx, by, bz)))

        # append newborns
        cells.extend(new_cells)

    return cells


# =======================================================
# Grasshopper Execution
# =======================================================
cells = simulate(N0, Steps, dt, Lx, Ly, Lz, speed, noise, repulsion_strength, division_rate, division_radius)

# Output A: Final points
FinalPoints = [rg.Point3d(x, y, z) for (x,y,z) in (c.pos for c in cells)]

# Output B: Trajectories
Trajectories = []
for c in cells:
    pts = [rg.Point3d(px,py,pz) for (px,py,pz) in c.history]
    if len(pts) > 1:
        Trajectories.append(rg.PolylineCurve(pts))

# Output C: Info
Info = "Initial: {}\nFinal: {}\nDivisions: {}".format(N0, len(cells), len(cells)-N0)
# ---------- end reaction_diffusion ----------
reaction_diffusion_animation = Python3Script(
    N0="3",
    Steps="300",
    dt="0.1",
    Lx="100",
    Ly="100",
    Lz="50",
    speed="50",
    noise="0.1",
    repulsion_strength="1",
    division_radius="10",
    division_rate="0.01",
    Run=Toggle(False),
    Reset=Button())  # -> out, FinalPoints, Trajectories, Info; inputs N0: Int32, Steps: Int32, dt: Double, Lx: Double, Ly: Double, Lz: Double, speed: Double, noise: Double, repulsion_strength: Double, division_radius: Double, division_rate: Double, Run: Boolean, Reset: Boolean
# ---------- reaction_diffusion_animation: Python ----------
import Rhino.Geometry as rg
import random
import scriptcontext as sc
from math import sqrt


# ---------------------------------------------------------
# CELL CLASS
# ---------------------------------------------------------
class Cell:
    def __init__(self, pos):
        self.pos = pos
        self.history = [pos]


# ---------------------------------------------------------
# REPULSION
# ---------------------------------------------------------
def repulsion(cells, idx, strength, min_dist=0.1):
    cx, cy, cz = cells[idx].pos
    fx = fy = fz = 0.0

    for j in range(len(cells)):
        if j == idx:
            continue

        x, y, z = cells[j].pos
        dx = cx - x
        dy = cy - y
        dz = cz - z

        d = sqrt(dx*dx + dy*dy + dz*dz)
        if d < min_dist and d > 1e-6:
            factor = strength * (1.0/d - 1.0/min_dist)
            fx += factor * (dx/d)
            fy += factor * (dy/d)
            fz += factor * (dz/d)

    return fx, fy, fz


# ---------------------------------------------------------
# SINGLE STEP UPDATE
# ---------------------------------------------------------
def update_cells(cells, dt, Lx, Ly, Lz, speed, noise, repulsion_strength, div_rate, div_radius):
    new_cells = []

    for i in range(len(cells)):
        cx, cy, cz = cells[i].pos

        # Movement (Random walk + noise)
        vx = (random.random()-0.5) * speed
        vy = (random.random()-0.5) * speed
        vz = (random.random()-0.5) * speed

        vx += noise*(random.random()-0.5)
        vy += noise*(random.random()-0.5)
        vz += noise*(random.random()-0.5)

        # Repulsion
        rx, ry, rz = repulsion(cells, i, repulsion_strength)
        vx += rx
        vy += ry
        vz += rz

        # Update position
        nx = max(0, min(Lx, cx + vx*dt))
        ny = max(0, min(Ly, cy + vy*dt))
        nz = max(0, min(Lz, cz + vz*dt))

        cells[i].pos = (nx, ny, nz)
        cells[i].history.append((nx, ny, nz))

        # Division
        if random.random() < div_rate:
            bx = max(0, min(Lx, nx + div_radius*(random.random()-0.5)))
            by = max(0, min(Ly, ny + div_radius*(random.random()-0.5)))
            bz = max(0, min(Lz, nz + div_radius*(random.random()-0.5)))

            new_cells.append(Cell((bx,by,bz)))

    cells.extend(new_cells)
    return cells, len(new_cells)


# ---------------------------------------------------------
# MAIN GH EXECUTION
# ---------------------------------------------------------

# Sticky keys
KEY_CELLS = "cells_state"
KEY_STEP  = "step_state"

# Reset simulation
if Reset or (KEY_CELLS not in sc.sticky):
    cells = []
    for i in range(N0):
        cells.append(Cell((
            random.random()*Lx,
            random.random()*Ly,
            random.random()*Lz
        )))
    sc.sticky[KEY_CELLS] = cells
    sc.sticky[KEY_STEP] = 0

cells = sc.sticky[KEY_CELLS]
step  = sc.sticky[KEY_STEP]


if Run:
    cells, new_count = update_cells(
        cells,
        dt,
        Lx, Ly, Lz,
        speed,
        noise,
        repulsion_strength,
        division_rate,
        division_radius
    )
    step += 1

    sc.sticky[KEY_CELLS] = cells
    sc.sticky[KEY_STEP] = step
else:
    new_count = 0


# ---------------------------------------------------------
# OUTPUT: Points + Trajectories + Info
# ---------------------------------------------------------

Points = [rg.Point3d(*c.pos) for c in cells]

Trajectories = []
for c in cells:
    if len(c.history) > 1:
        pts = [rg.Point3d(*p) for p in c.history]
        Trajectories.append(rg.PolylineCurve(pts))

Info = "Step: {}\nCells: {}\nNew this step: {}".format(step, len(cells), new_count)
# ---------- end reaction_diffusion_animation ----------
reaction_diffusion_animation_2 = Python3Script(
    N0="3",
    Steps="300",
    dt="0.1",
    Lx="100",
    Ly="100",
    Lz="50",
    speed="50",
    noise="0.1",
    repulsion_strength="10",
    division_radius="10",
    division_rate="0.01",
    Run=Toggle(True),
    Reset=Button())  # -> out, PointsTree, TrajTree, Info; inputs N0: Int32, Steps: Int32, dt: Double, Lx: Double, Ly: Double, Lz: Double, speed: Double, noise: Double, repulsion_strength: Double, division_radius: Double, division_rate: Double, Run: Boolean, Reset: Boolean
# ---------- reaction_diffusion_animation_2: Python ----------
import Rhino.Geometry as rg
import random
import scriptcontext as sc
from math import sqrt
from Grasshopper import DataTree
from Grasshopper.Kernel.Data import GH_Path

# ---------------------------------------------------------
# CELL CLASS
# ---------------------------------------------------------
class Cell:
    def __init__(self, pos):
        self.pos = pos
        self.history = [pos]


# ---------------------------------------------------------
# REPULSION
# ---------------------------------------------------------
def repulsion(cells, idx, strength, min_dist=0.1):
    cx, cy, cz = cells[idx].pos
    fx = fy = fz = 0.0

    for j in range(len(cells)):
        if j == idx:
            continue

        x, y, z = cells[j].pos
        dx = cx - x
        dy = cy - y
        dz = cz - z

        d = sqrt(dx*dx + dy*dy + dz*dz)
        if d < min_dist and d > 1e-6:
            factor = strength * (1.0/d - 1.0/min_dist)
            fx += factor * (dx/d)
            fy += factor * (dy/d)
            fz += factor * (dz/d)

    return fx, fy, fz


# ---------------------------------------------------------
# SINGLE STEP UPDATE
# ---------------------------------------------------------
def update_cells(cells, dt, Lx, Ly, Lz, speed, noise, repulsion_strength, div_rate, div_radius):
    new_cells = []

    for i in range(len(cells)):
        cx, cy, cz = cells[i].pos

        # Movement (Random walk + noise)
        vx = (random.random()-0.5) * speed
        vy = (random.random()-0.5) * speed
        vz = (random.random()-0.5) * speed

        vx += noise*(random.random()-0.5)
        vy += noise*(random.random()-0.5)
        vz += noise*(random.random()-0.5)

        # Repulsion
        rx, ry, rz = repulsion(cells, i, repulsion_strength)
        vx += rx
        vy += ry
        vz += rz

        # Update position
        nx = max(0, min(Lx, cx + vx*dt))
        ny = max(0, min(Ly, cy + vy*dt))
        nz = max(0, min(Lz, cz + vz*dt))

        cells[i].pos = (nx, ny, nz)
        cells[i].history.append((nx, ny, nz))

        # Division
        if random.random() < div_rate:
            bx = max(0, min(Lx, nx + div_radius*(random.random()-0.5)))
            by = max(0, min(Ly, ny + div_radius*(random.random()-0.5)))
            bz = max(0, min(Lz, nz + div_radius*(random.random()-0.5)))

            new_cells.append(Cell((bx,by,bz)))

    cells.extend(new_cells)
    return cells, len(new_cells)


# ---------------------------------------------------------
# MAIN GH EXECUTION
# ---------------------------------------------------------

# Sticky keys
KEY_CELLS = "cells_state"
KEY_STEP  = "step_state"

# Reset simulation
if Reset or (KEY_CELLS not in sc.sticky):
    cells = []
    for i in range(N0):
        cells.append(Cell((
            random.random()*Lx,
            random.random()*Ly,
            random.random()*Lz
        )))
    sc.sticky[KEY_CELLS] = cells
    sc.sticky[KEY_STEP] = 0

cells = sc.sticky[KEY_CELLS]
step  = sc.sticky[KEY_STEP]


if Run:
    cells, new_count = update_cells(
        cells,
        dt,
        Lx, Ly, Lz,
        speed,
        noise,
        repulsion_strength,
        division_rate,
        division_radius
    )
    step += 1

    sc.sticky[KEY_CELLS] = cells
    sc.sticky[KEY_STEP] = step
else:
    new_count = 0


# ---------------------------------------------------------
# OUTPUT: Points + Trajectories + Info
# ---------------------------------------------------------

# --- Points as separate branches ---
PointsTree = DataTree[rg.Point3d]()
for i, c in enumerate(cells):
    p = rg.Point3d(*c.pos)
    PointsTree.Add(p, GH_Path(i))


# --- Trajectories as separate branches ---
TrajTree = DataTree[rg.Curve]()
for i, c in enumerate(cells):
    if len(c.history) > 1:
        pts = [rg.Point3d(*p) for p in c.history]
        curve = rg.PolylineCurve(pts)
        TrajTree.Add(curve, GH_Path(i))


# Debug Info
Info = "Step: {}\nCells: {}\n".format(step, len(cells))
# ---------- end reaction_diffusion_animation_2 ----------
pt = ConstructPoint(XCoordinate="100", YCoordinate="100", ZCoordinate="50")
pt_2 = Point(Point(0, 0, 0))
panel = Panel(reaction_diffusion_animation.Info)
panel_2 = Panel(reaction_diffusion_animation_2.Info)
box = Box2Pt(PointA=pt_2, PointB=pt, Plane=PlaneXY(0, 0, 0))
preview = CustomPreview(
    Geometry=reaction_diffusion.FinalPoints,
    Material={diffuse=RGB(228, 178, 227), emission=RGB(68, 53, 68), shine=0.5, specular=RGB(255, 254, 255), transparency=0})
preview_2 = CustomPreview(
    Geometry=reaction_diffusion_animation.FinalPoints,
    Material={diffuse=RGB(228, 178, 227), emission=RGB(68, 53, 68), shine=0.5, specular=RGB(255, 254, 255), transparency=0})
preview_3 = CustomPreview(
    Geometry=reaction_diffusion_animation.Trajectories,
    Material={diffuse=RGB(228, 178, 227), emission=RGB(68, 53, 68), shine=0.5, specular=RGB(255, 254, 255), transparency=0})
voronoi³ = Voronoi3D(Points=flatten(reaction_diffusion_animation_2.PointsTree), Box=box)  # -> Cells, Boundary
explode = ExplodeObject(Object=voronoi³.Cells, Recursive=False)
explode_2 = ExplodeObject(Object=box, Recursive=False)
preview_4 = CustomPreview(Geometry=voronoi³.Cells, Material=ColourSwatch(SwatchColor=RGBA(64, 61, 61, 76)))
preview_5 = CustomPreview(
    Geometry=reaction_diffusion_animation_2.PointsTree,
    Material={diffuse=RGB(228, 178, 227), emission=RGB(68, 53, 68), shine=0.5, specular=RGB(255, 254, 255), transparency=0})
preview_6 = CustomPreview(
    Geometry=reaction_diffusion_animation_2.TrajTree,
    Material={diffuse=RGB(228, 178, 227), emission=RGB(68, 53, 68), shine=0.5, specular=RGB(255, 254, 255), transparency=0})
geo = Geometry(explode)
geo_2 = Geometry(explode_2)
area = Area(Geometry=flatten(explode))  # -> Area, Centroid
area_2 = Area(Geometry=explode_2)  # -> Area, Centroid
cullpt = CullDuplicates(Points=area.Centroid, Tolerance=0.1, CullMode=3)  # -> Points, Indices, Valence
