# Grasshopper definition 00_GH_Venus-Flower-Basket.gh (Grasshopper 1.0.8)

# ---- group: ignore
py3 = Python3Script(
    height=Slider(100, range=0..100),
    diameter=Slider(73, range=0..1000),
    taper=Slider(0.5, range=0..10),
    fiber_diameter=Slider(0.5, range=0..10),
    vertical_ridges=Slider(5, range=0..10),
    horizontal_rings=Slider(32, range=0..100),
    diagonal_density=Slider(30, range=0..100),
    include_verticals=Toggle(True),
    include_horizontals=Toggle(True),
    include_diagonals=Toggle(True),
    organic_variation=Slider(0.15, range=0..1),
    hierarchical_bundles=Toggle(True),
    seed=Slider(60, range=0..100))  # -> a, b, c, d; inputs height: Double, diameter: Double, taper: Double, fiber_diameter: Double, vertical_ridges: Int32, horizontal_rings: Int32, diagonal_density: Int32, include_verticals: Boolean, include_horizontals: Boolean, include_diagonals: Boolean
# ---------- py3: Python ----------
"""
Venus Flower Basket Structure Generator for Grasshopper
Based on actual Euplectella aspergillum skeletal architecture:
- Hierarchical spicule organization
- Cylindrical form with vertical ridges (bundled spicules)
- Horizontal rings
- Diagonal bracing in crisscross pattern
- Natural variation and irregularity

Inputs:
    surface: Surface or Mesh - Target geometry (default: cylinder)
    height: float - Overall height
    diameter: float - Base diameter
    taper: float - Taper ratio (0-1)
    fiber_diameter: float - Base thickness of fibers
    vertical_ridges: int - Number of main vertical ridges (typically 4-8)
    horizontal_rings: int - Number of horizontal rings
    diagonal_density: int - Density of diagonal braces
    include_verticals: bool - Include vertical ridges
    include_horizontals: bool - Include horizontal rings
    include_diagonals: bool - Include diagonal braces
    organic_variation: float - Amount of natural irregularity (0-1)
    hierarchical_bundles: bool - Create thicker bundled ridges
    seed: int - Random seed for variation
"""

import Rhino.Geometry as rg
import math
import random

# Default values matching your setup
if 'height' not in dir(): height = 100
if 'diameter' not in dir(): diameter = 150
if 'taper' not in dir(): taper = 0.1
if 'fiber_diameter' not in dir(): fiber_diameter = 4.1
if 'vertical_ridges' not in dir(): vertical_ridges = 4
if 'horizontal_rings' not in dir(): horizontal_rings = 50
if 'diagonal_density' not in dir(): diagonal_density = 30
if 'include_verticals' not in dir(): include_verticals = True
if 'include_horizontals' not in dir(): include_horizontals = True
if 'include_diagonals' not in dir(): include_diagonals = True
if 'organic_variation' not in dir(): organic_variation = 0.15
if 'hierarchical_bundles' not in dir(): hierarchical_bundles = True
if 'seed' not in dir(): seed = 42

# Set random seed
random.seed(seed)

# Check if custom surface provided
use_custom_surface = 'surface' in dir() and surface is not None

# Output lists
vertical_fibers = []
horizontal_fibers = []
diagonal_left = []
diagonal_right = []

def get_radius_at_height(h, base_radius, taper_ratio):
    """Calculate radius at given height considering taper"""
    return base_radius * (1 - taper_ratio * (h / height))

def create_point_on_cylinder(h, angle, base_radius, taper_ratio):
    """Create a point on the tapered cylindrical surface with organic variation"""
    r = get_radius_at_height(h, base_radius, taper_ratio)
    
    # Add subtle organic variation
    if organic_variation > 0:
        noise_scale = organic_variation * 5.0
        r += random.uniform(-noise_scale, noise_scale)
    
    x = r * math.cos(angle)
    y = r * math.sin(angle)
    return rg.Point3d(x, y, h)

if not use_custom_surface:
    # Generate on parametric cylinder
    
    # 1. VERTICAL RIDGES - Main structural elements with hierarchical bundling
    if include_verticals:
        for ridge in range(vertical_ridges):
            angle = (ridge / float(vertical_ridges)) * 2 * math.pi
            
            # Determine if this is a major ridge (bundled spicules)
            thickness_mult = 1.0
            if hierarchical_bundles and ridge % 2 == 0:
                thickness_mult = 2.0  # Major ridges are thicker
            
            points = []
            for i in range(horizontal_rings + 1):
                h = (i / float(horizontal_rings)) * height
                
                # Add slight waviness to vertical ridges
                angle_offset = 0
                if organic_variation > 0:
                    angle_offset = math.sin(h / height * math.pi * 4) * organic_variation * 0.1
                
                point = create_point_on_cylinder(h, angle + angle_offset, diameter/2, taper)
                points.append(point)
            
            if len(points) > 1:
                curve = rg.Curve.CreateInterpolatedCurve(points, 3)
                if curve:
                    pipe_radius = (fiber_diameter * thickness_mult) / 2
                    pipe = rg.Brep.CreatePipe(curve, pipe_radius, False, 
                                              rg.PipeCapMode.Round, True, 0.01, 0.01)
                    if pipe:
                        vertical_fibers.extend(pipe)
    
    # 2. HORIZONTAL RINGS - Circumferential reinforcement with variation
    if include_horizontals:
        for ring in range(horizontal_rings + 1):
            h = (ring / float(horizontal_rings)) * height
            r = get_radius_at_height(h, diameter/2, taper)
            
            # Add organic variation to ring position
            if organic_variation > 0:
                h += random.uniform(-organic_variation * 2, organic_variation * 2)
            
            # Create slightly wavy circle
            if organic_variation > 0:
                # Create wavy ring instead of perfect circle
                points = []
                num_pts = 60
                for i in range(num_pts + 1):
                    angle = (i / float(num_pts)) * 2 * math.pi
                    r_varied = r + random.uniform(-organic_variation * 3, organic_variation * 3)
                    x = r_varied * math.cos(angle)
                    y = r_varied * math.sin(angle)
                    points.append(rg.Point3d(x, y, h))
                
                curve = rg.Curve.CreateInterpolatedCurve(points, 3, rg.CurveKnotStyle.Uniform, points[0], points[0])
            else:
                # Perfect circle
                plane = rg.Plane(rg.Point3d(0, 0, h), rg.Vector3d.ZAxis)
                circle = rg.Circle(plane, r)
                curve = circle.ToNurbsCurve()
            
            if curve:
                pipe = rg.Brep.CreatePipe(curve, fiber_diameter/2, False, 
                                          rg.PipeCapMode.Round, True, 0.01, 0.01)
                if pipe:
                    horizontal_fibers.extend(pipe)
    
    # 3. DIAGONAL BRACES - The characteristic crisscross pattern with irregularity
    if include_diagonals:
        # Left-handed diagonals
        for diag in range(diagonal_density):
            start_angle = (diag / float(diagonal_density)) * 2 * math.pi
            
            # Randomly skip some diagonals for organic variation
            if organic_variation > 0 and random.random() < organic_variation * 0.3:
                continue
            
            points = []
            for i in range(horizontal_rings + 1):
                h = (i / float(horizontal_rings)) * height
                
                # Diagonal wraps around as it goes up with some variation
                angle = start_angle + (i / float(horizontal_rings)) * 2 * math.pi
                
                if organic_variation > 0:
                    angle += random.uniform(-organic_variation * 0.2, organic_variation * 0.2)
                
                point = create_point_on_cylinder(h, angle, diameter/2, taper)
                points.append(point)
            
            if len(points) > 1:
                curve = rg.Curve.CreateInterpolatedCurve(points, 3)
                if curve:
                    pipe = rg.Brep.CreatePipe(curve, fiber_diameter/2, False, 
                                              rg.PipeCapMode.Round, True, 0.01, 0.01)
                    if pipe:
                        diagonal_left.extend(pipe)
        
        # Right-handed diagonals (opposite direction)
        for diag in range(diagonal_density):
            start_angle = (diag / float(diagonal_density)) * 2 * math.pi
            
            # Randomly skip some diagonals for organic variation
            if organic_variation > 0 and random.random() < organic_variation * 0.3:
                continue
            
            points = []
            for i in range(horizontal_rings + 1):
                h = (i / float(horizontal_rings)) * height
                
                # Diagonal wraps in opposite direction with variation
                angle = start_angle - (i / float(horizontal_rings)) * 2 * math.pi
                
                if organic_variation > 0:
                    angle += random.uniform(-organic_variation * 0.2, organic_variation * 0.2)
                
                point = create_point_on_cylinder(h, angle, diameter/2, taper)
                points.append(point)
            
            if len(points) > 1:
                curve = rg.Curve.CreateInterpolatedCurve(points, 3)
                if curve:
                    pipe = rg.Brep.CreatePipe(curve, fiber_diameter/2, False, 
                                              rg.PipeCapMode.Round, True, 0.01, 0.01)
                    if pipe:
                        diagonal_right.extend(pipe)

else:
    # Apply pattern to custom surface
    # Extract surface for manipulation
    if hasattr(surface, 'Faces'):
        surf = surface.Faces[0]
    else:
        surf = surface
    
    u_domain = surf.Domain(0)
    v_domain = surf.Domain(1)
    
    # Vertical ridges on custom surface
    if include_verticals:
        for ridge in range(vertical_ridges):
            u = u_domain.Min + (ridge / float(vertical_ridges)) * (u_domain.Max - u_domain.Min)
            
            points = []
            for i in range(horizontal_rings + 1):
                v = v_domain.Min + (i / float(horizontal_rings)) * (v_domain.Max - v_domain.Min)
                point = surf.PointAt(u, v)
                points.append(point)
            
            if len(points) > 1:
                curve = rg.Curve.CreateInterpolatedCurve(points, 3)
                if curve:
                    pipe = rg.Brep.CreatePipe(curve, fiber_diameter/2, False, 
                                              rg.PipeCapMode.Round, True, 0.01, 0.01)
                    if pipe:
                        vertical_fibers.extend(pipe)
    
    # Horizontal rings on custom surface
    if include_horizontals:
        for ring in range(horizontal_rings + 1):
            v = v_domain.Min + (ring / float(horizontal_rings)) * (v_domain.Max - v_domain.Min)
            
            iso_curve = surf.IsoCurve(1, v)
            if iso_curve:
                pipe = rg.Brep.CreatePipe(iso_curve, fiber_diameter/2, False, 
                                          rg.PipeCapMode.Round, True, 0.01, 0.01)
                if pipe:
                    horizontal_fibers.extend(pipe)
    
    # Diagonal braces on custom surface
    if include_diagonals:
        # Left diagonals
        for diag in range(diagonal_density):
            points = []
            for i in range(horizontal_rings + 1):
                u_frac = ((diag + i) / float(diagonal_density)) % 1.0
                v_frac = i / float(horizontal_rings)
                
                u = u_domain.Min + u_frac * (u_domain.Max - u_domain.Min)
                v = v_domain.Min + v_frac * (v_domain.Max - v_domain.Min)
                point = surf.PointAt(u, v)
                points.append(point)
            
            if len(points) > 1:
                curve = rg.Curve.CreateInterpolatedCurve(points, 3)
                if curve:
                    pipe = rg.Brep.CreatePipe(curve, fiber_diameter/2, False, 
                                              rg.PipeCapMode.Round, True, 0.01, 0.01)
                    if pipe:
                        diagonal_left.extend(pipe)
        
        # Right diagonals
        for diag in range(diagonal_density):
            points = []
            for i in range(horizontal_rings + 1):
                u_frac = ((diag - i) / float(diagonal_density)) % 1.0
                v_frac = i / float(horizontal_rings)
                
                u = u_domain.Min + u_frac * (u_domain.Max - u_domain.Min)
                v = v_domain.Min + v_frac * (v_domain.Max - v_domain.Min)
                point = surf.PointAt(u, v)
                points.append(point)
            
            if len(points) > 1:
                curve = rg.Curve.CreateInterpolatedCurve(points, 3)
                if curve:
                    pipe = rg.Brep.CreatePipe(curve, fiber_diameter/2, False, 
                                              rg.PipeCapMode.Round, True, 0.01, 0.01)
                    if pipe:
                        diagonal_right.extend(pipe)

# Combine all geometry
all_fibers = vertical_fibers + horizontal_fibers + diagonal_left + diagonal_right

# Output information
print("Venus Flower Basket Structure Generated:")
print(f"  Vertical ridges: {len(vertical_fibers)}")
print(f"  Horizontal rings: {len(horizontal_fibers)}")
print(f"  Left diagonals: {len(diagonal_left)}")
print(f"  Right diagonals: {len(diagonal_right)}")
print(f"  Total elements: {len(all_fibers)}")

# Assign outputs
a = all_fibers  # All combined geometry
b = vertical_fibers  # Just vertical ridges
c = horizontal_fibers  # Just horizontal rings
d = diagonal_left + diagonal_right  # Just diagonal braces
# ---------- end py3 ----------

# ---- group: Create Structure
py3_2 = Python3Script(
    height=Slider(100, range=0..100),
    diameter=Slider(45, range=0..1000),
    taper=Slider(0.2, range=0..1),
    fiber_diameter=Slider(1, range=0..10),
    cell_density=Slider(40, range=0..100),
    radial_cells=Slider(40, range=0..100),
    diagonal_guides=Slider(23, range=0..100),
    include_framework=Toggle(True),
    framework_thickness=Slider(1, range=0..10),
    seed=Slider(53, range=0..100))  # -> a, b, c, d; inputs height: Double, diameter: Double, taper: Double, fiber_diameter: Double, cell_density: Int32, radial_cells: Int32, framework_thickness: Double, seed: Int32; disabled
# ---------- py3_2: Python ----------
"""
Venus Flower Basket Structure Generator for Grasshopper
Creates the characteristic irregular polygonal cell structure seen in cross-section
Using Voronoi tessellation within a diagonal lattice framework

Inputs:
    height: float - Overall height
    diameter: float - Base diameter
    taper: float - Taper ratio (0-1)
    fiber_diameter: float - Base thickness of fibers
    cell_density: int - Number of Voronoi cells vertically
    radial_cells: int - Number of cells radially
    diagonal_guides: int - Number of diagonal guide lines
    include_framework: bool - Include diagonal lattice framework
    framework_thickness: float - Multiplier for framework thickness
    seed: int - Random seed for cell distribution
"""

import Rhino.Geometry as rg
import math
import random

# Default values
if 'height' not in dir(): height = 100
if 'diameter' not in dir(): diameter = 150
if 'taper' not in dir(): taper = 0.1
if 'fiber_diameter' not in dir(): fiber_diameter = 2.5
if 'cell_density' not in dir(): cell_density = 40
if 'radial_cells' not in dir(): radial_cells = 30
if 'diagonal_guides' not in dir(): diagonal_guides = 15
if 'include_framework' not in dir(): include_framework = True
if 'framework_thickness' not in dir(): framework_thickness = 1.5
if 'seed' not in dir(): seed = 42

# Set random seed
random.seed(seed)

# Output lists
voronoi_fibers = []
framework_fibers = []

def get_radius_at_height(h, base_radius, taper_ratio):
    """Calculate radius at given height considering taper"""
    return base_radius * (1 - taper_ratio * (h / height))

def create_point_on_cylinder(h, angle, base_radius, taper_ratio):
    """Create a point on the tapered cylindrical surface"""
    r = get_radius_at_height(h, base_radius, taper_ratio)
    x = r * math.cos(angle)
    y = r * math.sin(angle)
    return rg.Point3d(x, y, h)

def generate_voronoi_seeds_on_surface(num_cells_vertical, num_cells_radial, base_radius):
    """Generate seed points distributed on cylindrical surface with natural variation"""
    seeds = []
    
    num_cells_vertical = int(num_cells_vertical)
    num_cells_radial = int(num_cells_radial)
    
    for i in range(num_cells_vertical):
        h = (i / float(num_cells_vertical - 1)) * height
        # Add vertical variation
        h += random.uniform(-height * 0.02, height * 0.02)
        
        for j in range(num_cells_radial):
            angle = (j / float(num_cells_radial)) * 2 * math.pi
            # Add angular variation
            angle += random.uniform(-0.2, 0.2)
            
            # Add slight radial variation
            r_variation = random.uniform(0.95, 1.05)
            point = create_point_on_cylinder(h, angle, base_radius * r_variation, taper)
            seeds.append((h, angle, point))
    
    return seeds

def find_voronoi_neighbors(seeds, max_distance):
    """Find neighboring Voronoi cells and create edges between them"""
    edges = []
    
    for i, seed1 in enumerate(seeds):
        h1, angle1, pt1 = seed1
        
        # Find nearby seeds
        for j, seed2 in enumerate(seeds):
            if i >= j:  # Avoid duplicates
                continue
            
            h2, angle2, pt2 = seed2
            
            # Calculate distance
            dist = pt1.DistanceTo(pt2)
            
            # Only connect if close enough (creates Voronoi-like structure)
            if dist < max_distance:
                # Check if they're reasonable neighbors (not too far in angle or height)
                angle_diff = abs(angle1 - angle2)
                if angle_diff > math.pi:
                    angle_diff = 2 * math.pi - angle_diff
                
                height_diff = abs(h1 - h2)
                
                # Connect if reasonable neighbors
                if angle_diff < math.pi/3 and height_diff < height * 0.15:
                    edges.append((pt1, pt2))
    
    return edges

# Generate Voronoi seed points on cylindrical surface
print("Generating Voronoi seeds...")
seeds = generate_voronoi_seeds_on_surface(cell_density, radial_cells, diameter/2)

# Calculate appropriate neighbor distance
avg_spacing = (height / cell_density + 2 * math.pi * (diameter/2) / radial_cells) / 2
max_neighbor_dist = avg_spacing * 1.6

print("Creating Voronoi edges...")
edges = find_voronoi_neighbors(seeds, max_neighbor_dist)

# Create curves and pipes for Voronoi cell edges
print("Creating fiber geometry...")
for pt1, pt2 in edges:
    # Create curve between points, following surface
    mid_steps = 5
    curve_points = []
    
    for step in range(mid_steps + 1):
        t = step / float(mid_steps)
        
        # Interpolate
        x = pt1.X + (pt2.X - pt1.X) * t
        y = pt1.Y + (pt2.Y - pt1.Y) * t
        z = pt1.Z + (pt2.Z - pt1.Z) * t
        
        # Project back to cylindrical surface
        angle = math.atan2(y, x)
        h = z
        r = get_radius_at_height(h, diameter/2, taper)
        
        surf_pt = rg.Point3d(r * math.cos(angle), r * math.sin(angle), h)
        curve_points.append(surf_pt)
    
    if len(curve_points) > 1:
        curve = rg.Curve.CreateInterpolatedCurve(curve_points, 3)
        if curve:
            pipe = rg.Brep.CreatePipe(curve, fiber_diameter/2, False, 
                                      rg.PipeCapMode.Round, True, 0.01, 0.01)
            if pipe:
                voronoi_fibers.extend(pipe)

# Add diagonal framework guides (the organizing structure)
if include_framework:
    print("Creating diagonal framework...")
    
    diagonal_guides = int(diagonal_guides)
    
    # Left diagonals
    for diag in range(diagonal_guides):
        start_angle = (diag / float(diagonal_guides)) * 2 * math.pi
        
        points = []
        num_points = int(cell_density)
        for i in range(num_points):
            h = (i / float(num_points - 1)) * height
            angle = start_angle + (i / float(num_points - 1)) * 2 * math.pi
            point = create_point_on_cylinder(h, angle, diameter/2, taper)
            points.append(point)
        
        if len(points) > 1:
            curve = rg.Curve.CreateInterpolatedCurve(points, 3)
            if curve:
                pipe_radius = (fiber_diameter * framework_thickness) / 2
                pipe = rg.Brep.CreatePipe(curve, pipe_radius, False, 
                                          rg.PipeCapMode.Round, True, 0.01, 0.01)
                if pipe:
                    framework_fibers.extend(pipe)
    
    # Right diagonals
    for diag in range(diagonal_guides):
        start_angle = (diag / float(diagonal_guides)) * 2 * math.pi
        
        points = []
        num_points = int(cell_density)
        for i in range(num_points):
            h = (i / float(num_points - 1)) * height
            angle = start_angle - (i / float(num_points - 1)) * 2 * math.pi
            point = create_point_on_cylinder(h, angle, diameter/2, taper)
            points.append(point)
        
        if len(points) > 1:
            curve = rg.Curve.CreateInterpolatedCurve(points, 3)
            if curve:
                pipe_radius = (fiber_diameter * framework_thickness) / 2
                pipe = rg.Brep.CreatePipe(curve, pipe_radius, False, 
                                          rg.PipeCapMode.Round, True, 0.01, 0.01)
                if pipe:
                    framework_fibers.extend(pipe)

# Combine all geometry
all_fibers = voronoi_fibers + framework_fibers

# Output information
print("Venus Flower Basket Structure Generated:")
print(f"  Voronoi cell edges: {len(voronoi_fibers)}")
print(f"  Framework guides: {len(framework_fibers)}")
print(f"  Total elements: {len(all_fibers)}")
print(f"  Seeds generated: {len(seeds)}")
print(f"  Edges created: {len(edges)}")

# Assign outputs
a = all_fibers  # All combined geometry
b = voronoi_fibers  # Just Voronoi cells
c = framework_fibers  # Just diagonal framework
d = [seed[2] for seed in seeds]  # Seed points for visualization
# ---------- end py3_2 ----------

# ---- group: ignore
toggle = BooleanToggle(True)
py3_3 = Python3Script(
    height=Slider(100, range=0..100),
    diameter=Slider(73, range=0..1000),
    taper=Slider(0.5, range=0..10),
    fiber_diameter=Slider(0.5, range=0..10),
    vertical_ridges=Slider(5, range=0..10),
    horizontal_rings=Slider(32, range=0..100),
    diagonal_density=Slider(30, range=0..100),
    include_verticals=toggle,
    include_horizontals=toggle,
    include_diagonals=toggle)  # -> a, b, c, d; inputs height: Double, diameter: Double, taper: Double, fiber_diameter: Double, vertical_ridges: Int32, horizontal_rings: Int32, diagonal_density: Int32, include_verticals: Boolean, include_horizontals: Boolean, include_diagonals: Boolean
# ---------- py3_3: Python ----------
"""
Venus Flower Basket Structure Generator for Grasshopper
Based on actual Euplectella aspergillum skeletal architecture:
- Cylindrical form with vertical ridges
- Horizontal rings
- Diagonal bracing in crisscross pattern
- Square lattice reinforcement

Inputs:
    surface: Surface or Mesh - Target geometry (default: cylinder)
    height: float - Overall height
    diameter: float - Base diameter
    taper: float - Taper ratio (0-1)
    fiber_diameter: float - Thickness of fibers
    vertical_ridges: int - Number of main vertical ridges (typically 4-8)
    horizontal_rings: int - Number of horizontal rings
    diagonal_density: int - Density of diagonal braces
    include_verticals: bool - Include vertical ridges
    include_horizontals: bool - Include horizontal rings
    include_diagonals: bool - Include diagonal braces
"""

import Rhino.Geometry as rg
import math

# Default values matching your setup
if 'height' not in dir(): height = 100
if 'diameter' not in dir(): diameter = 150
if 'taper' not in dir(): taper = 0.1
if 'fiber_diameter' not in dir(): fiber_diameter = 4.1
if 'vertical_ridges' not in dir(): vertical_ridges = 4
if 'horizontal_rings' not in dir(): horizontal_rings = 50
if 'diagonal_density' not in dir(): diagonal_density = 30
if 'include_verticals' not in dir(): include_verticals = True
if 'include_horizontals' not in dir(): include_horizontals = True
if 'include_diagonals' not in dir(): include_diagonals = True

# Check if custom surface provided
use_custom_surface = 'surface' in dir() and surface is not None

# Output lists
vertical_fibers = []
horizontal_fibers = []
diagonal_left = []
diagonal_right = []

def get_radius_at_height(h, base_radius, taper_ratio):
    """Calculate radius at given height considering taper"""
    return base_radius * (1 - taper_ratio * (h / height))

def create_point_on_cylinder(h, angle, base_radius, taper_ratio):
    """Create a point on the tapered cylindrical surface"""
    r = get_radius_at_height(h, base_radius, taper_ratio)
    x = r * math.cos(angle)
    y = r * math.sin(angle)
    return rg.Point3d(x, y, h)

if not use_custom_surface:
    # Generate on parametric cylinder
    
    # 1. VERTICAL RIDGES - Main structural elements
    if include_verticals:
        for ridge in range(vertical_ridges):
            angle = (ridge / float(vertical_ridges)) * 2 * math.pi
            
            points = []
            for i in range(horizontal_rings + 1):
                h = (i / float(horizontal_rings)) * height
                point = create_point_on_cylinder(h, angle, diameter/2, taper)
                points.append(point)
            
            if len(points) > 1:
                curve = rg.Curve.CreateInterpolatedCurve(points, 3)
                if curve:
                    pipe = rg.Brep.CreatePipe(curve, fiber_diameter/2, False, 
                                              rg.PipeCapMode.Round, True, 0.01, 0.01)
                    if pipe:
                        vertical_fibers.extend(pipe)
    
    # 2. HORIZONTAL RINGS - Circumferential reinforcement
    if include_horizontals:
        for ring in range(horizontal_rings + 1):
            h = (ring / float(horizontal_rings)) * height
            r = get_radius_at_height(h, diameter/2, taper)
            
            # Create circle at this height
            plane = rg.Plane(rg.Point3d(0, 0, h), rg.Vector3d.ZAxis)
            circle = rg.Circle(plane, r)
            curve = circle.ToNurbsCurve()
            
            pipe = rg.Brep.CreatePipe(curve, fiber_diameter/2, False, 
                                      rg.PipeCapMode.Round, True, 0.01, 0.01)
            if pipe:
                horizontal_fibers.extend(pipe)
    
    # 3. DIAGONAL BRACES - The characteristic crisscross pattern
    if include_diagonals:
        # Left-handed diagonals
        for diag in range(diagonal_density):
            start_angle = (diag / float(diagonal_density)) * 2 * math.pi
            
            points = []
            for i in range(horizontal_rings + 1):
                h = (i / float(horizontal_rings)) * height
                # Diagonal wraps around as it goes up
                angle = start_angle + (i / float(horizontal_rings)) * 2 * math.pi
                point = create_point_on_cylinder(h, angle, diameter/2, taper)
                points.append(point)
            
            if len(points) > 1:
                curve = rg.Curve.CreateInterpolatedCurve(points, 3)
                if curve:
                    pipe = rg.Brep.CreatePipe(curve, fiber_diameter/2, False, 
                                              rg.PipeCapMode.Round, True, 0.01, 0.01)
                    if pipe:
                        diagonal_left.extend(pipe)
        
        # Right-handed diagonals (opposite direction)
        for diag in range(diagonal_density):
            start_angle = (diag / float(diagonal_density)) * 2 * math.pi
            
            points = []
            for i in range(horizontal_rings + 1):
                h = (i / float(horizontal_rings)) * height
                # Diagonal wraps in opposite direction
                angle = start_angle - (i / float(horizontal_rings)) * 2 * math.pi
                point = create_point_on_cylinder(h, angle, diameter/2, taper)
                points.append(point)
            
            if len(points) > 1:
                curve = rg.Curve.CreateInterpolatedCurve(points, 3)
                if curve:
                    pipe = rg.Brep.CreatePipe(curve, fiber_diameter/2, False, 
                                              rg.PipeCapMode.Round, True, 0.01, 0.01)
                    if pipe:
                        diagonal_right.extend(pipe)

else:
    # Apply pattern to custom surface
    # Extract surface for manipulation
    if hasattr(surface, 'Faces'):
        surf = surface.Faces[0]
    else:
        surf = surface
    
    u_domain = surf.Domain(0)
    v_domain = surf.Domain(1)
    
    # Vertical ridges on custom surface
    if include_verticals:
        for ridge in range(vertical_ridges):
            u = u_domain.Min + (ridge / float(vertical_ridges)) * (u_domain.Max - u_domain.Min)
            
            points = []
            for i in range(horizontal_rings + 1):
                v = v_domain.Min + (i / float(horizontal_rings)) * (v_domain.Max - v_domain.Min)
                point = surf.PointAt(u, v)
                points.append(point)
            
            if len(points) > 1:
                curve = rg.Curve.CreateInterpolatedCurve(points, 3)
                if curve:
                    pipe = rg.Brep.CreatePipe(curve, fiber_diameter/2, False, 
                                              rg.PipeCapMode.Round, True, 0.01, 0.01)
                    if pipe:
                        vertical_fibers.extend(pipe)
    
    # Horizontal rings on custom surface
    if include_horizontals:
        for ring in range(horizontal_rings + 1):
            v = v_domain.Min + (ring / float(horizontal_rings)) * (v_domain.Max - v_domain.Min)
            
            iso_curve = surf.IsoCurve(1, v)
            if iso_curve:
                pipe = rg.Brep.CreatePipe(iso_curve, fiber_diameter/2, False, 
                                          rg.PipeCapMode.Round, True, 0.01, 0.01)
                if pipe:
                    horizontal_fibers.extend(pipe)
    
    # Diagonal braces on custom surface
    if include_diagonals:
        # Left diagonals
        for diag in range(diagonal_density):
            points = []
            for i in range(horizontal_rings + 1):
                u_frac = ((diag + i) / float(diagonal_density)) % 1.0
                v_frac = i / float(horizontal_rings)
                
                u = u_domain.Min + u_frac * (u_domain.Max - u_domain.Min)
                v = v_domain.Min + v_frac * (v_domain.Max - v_domain.Min)
                point = surf.PointAt(u, v)
                points.append(point)
            
            if len(points) > 1:
                curve = rg.Curve.CreateInterpolatedCurve(points, 3)
                if curve:
                    pipe = rg.Brep.CreatePipe(curve, fiber_diameter/2, False, 
                                              rg.PipeCapMode.Round, True, 0.01, 0.01)
                    if pipe:
                        diagonal_left.extend(pipe)
        
        # Right diagonals
        for diag in range(diagonal_density):
            points = []
            for i in range(horizontal_rings + 1):
                u_frac = ((diag - i) / float(diagonal_density)) % 1.0
                v_frac = i / float(horizontal_rings)
                
                u = u_domain.Min + u_frac * (u_domain.Max - u_domain.Min)
                v = v_domain.Min + v_frac * (v_domain.Max - v_domain.Min)
                point = surf.PointAt(u, v)
                points.append(point)
            
            if len(points) > 1:
                curve = rg.Curve.CreateInterpolatedCurve(points, 3)
                if curve:
                    pipe = rg.Brep.CreatePipe(curve, fiber_diameter/2, False, 
                                              rg.PipeCapMode.Round, True, 0.01, 0.01)
                    if pipe:
                        diagonal_right.extend(pipe)

# Combine all geometry
all_fibers = vertical_fibers + horizontal_fibers + diagonal_left + diagonal_right

# Output information
print("Venus Flower Basket Structure Generated:")
print(f"  Vertical ridges: {len(vertical_fibers)}")
print(f"  Horizontal rings: {len(horizontal_fibers)}")
print(f"  Left diagonals: {len(diagonal_left)}")
print(f"  Right diagonals: {len(diagonal_right)}")
print(f"  Total elements: {len(all_fibers)}")

# Assign outputs
a = all_fibers  # All combined geometry
b = vertical_fibers  # Just vertical ridges
c = horizontal_fibers  # Just horizontal rings
d = diagonal_left + diagonal_right  # Just diagonal braces
# ---------- end py3_3 ----------

# ---- group: Apply Structure to Surface
srf = Surface(<surface referenced from the Rhino model>)
py3_4 = Python3Script(
    surface=srf,
    height=Slider(1, range=0..100),
    diameter=Slider(3, range=0..1000),
    taper=Slider(0.1, range=0..0.1),
    fiber_diameter=Slider(1, range=0..10),
    cell_density_u=Slider(12, range=0..100),
    cell_density_v=Slider(40, range=0..100),
    diagonal_guides=Slider(15, range=0..100),
    include_framework=Toggle(False),
    framework_thickness=Slider(0.3, range=0..10),
    pattern_type=Slider(0, range=0..2),
    seed=Slider(10, range=0..100))  # -> a, b, c, d; inputs height: Double, diameter: Double, taper: Double, fiber_diameter: Double, cell_density_u: Int32, framework_thickness: Double, pattern_type: Int32, seed: Int32
# ---------- py3_4: Python ----------
"""
Venus Flower Basket Structure Generator for Grasshopper
Creates Voronoi-like cellular pattern that can be applied to ANY surface
Perfect for facades, curved surfaces, or cylindrical forms

Inputs:
    surface: Surface - Target surface (if None, creates cylinder)
    height: float - Overall height (for default cylinder)
    diameter: float - Base diameter (for default cylinder)
    taper: float - Taper ratio (0-1, for default cylinder)
    fiber_diameter: float - Base thickness of fibers
    cell_density_u: int - Number of cells in U direction
    cell_density_v: int - Number of cells in V direction
    diagonal_guides: int - Number of diagonal guide lines
    include_framework: bool - Include diagonal lattice framework
    framework_thickness: float - Multiplier for framework thickness
    pattern_type: int - 0=Voronoi only, 1=Framework only, 2=Combined
    seed: int - Random seed for cell distribution
"""

import Rhino.Geometry as rg
import math
import random
import System

# Default values
if 'height' not in dir(): height = 100
if 'diameter' not in dir(): diameter = 150
if 'taper' not in dir(): taper = 0.1
if 'fiber_diameter' not in dir(): fiber_diameter = 2.5
if 'cell_density_u' not in dir(): cell_density_u = 30
if 'cell_density_v' not in dir(): cell_density_v = 40
if 'diagonal_guides' not in dir(): diagonal_guides = 15
if 'include_framework' not in dir(): include_framework = True
if 'framework_thickness' not in dir(): framework_thickness = 1.5
if 'pattern_type' not in dir(): pattern_type = 2
if 'seed' not in dir(): seed = 42

# Set random seed
random.seed(seed)

# Check if custom surface provided, otherwise create cylinder
if 'surface' not in dir() or surface is None:
    # Create default tapered cylinder
    circle = rg.Circle(rg.Plane.WorldXY, diameter/2)
    cylinder = rg.Cylinder(circle, height)
    base_surface = cylinder.ToBrep(True, True)
    if base_surface:
        target_surface = base_surface.Faces[0]
    print("Using default cylinder surface")
else:
    # Use provided surface - handle different input types
    import Rhino
    import scriptcontext as sc
    
    # If it's a GUID, get the actual geometry
    if isinstance(surface, System.Guid):
        obj = sc.doc.Objects.Find(surface)
        if obj:
            geometry = obj.Geometry
            if hasattr(geometry, 'Faces'):
                target_surface = geometry.Faces[0]
            else:
                target_surface = geometry
        else:
            print("ERROR: Could not find surface object")
            target_surface = None
    # If it's a Brep
    elif hasattr(surface, 'Faces'):
        target_surface = surface.Faces[0]
    # If it's already a surface
    else:
        target_surface = surface
    
    print("Using custom surface")

# Output lists
voronoi_fibers = []
framework_fibers = []
seed_points = []

def generate_voronoi_seeds_on_surface(surf, num_u, num_v):
    """Generate seed points distributed across surface UV space with variation"""
    seeds = []
    
    num_u = int(num_u)
    num_v = int(num_v)
    
    u_domain = surf.Domain(0)
    v_domain = surf.Domain(1)
    
    u_step = (u_domain.Max - u_domain.Min) / float(num_u - 1)
    v_step = (v_domain.Max - v_domain.Min) / float(num_v - 1)
    
    for i in range(num_u):
        for j in range(num_v):
            # Base UV coordinates
            u = u_domain.Min + i * u_step
            v = v_domain.Min + j * v_step
            
            # Add random variation
            u += random.uniform(-u_step * 0.3, u_step * 0.3)
            v += random.uniform(-v_step * 0.3, v_step * 0.3)
            
            # Clamp to domain
            u = max(u_domain.Min, min(u_domain.Max, u))
            v = max(v_domain.Min, min(v_domain.Max, v))
            
            # Get 3D point on surface
            point = surf.PointAt(u, v)
            seeds.append((u, v, point))
    
    return seeds

def find_voronoi_neighbors(seeds, surf, max_distance_factor=1.6):
    """Find neighboring Voronoi cells and create edges between them"""
    edges = []
    
    u_domain = surf.Domain(0)
    v_domain = surf.Domain(1)
    
    # Calculate average spacing
    if len(seeds) > 1:
        u_range = u_domain.Max - u_domain.Min
        v_range = v_domain.Max - v_domain.Min
        avg_u_spacing = u_range / math.sqrt(len(seeds))
        avg_v_spacing = v_range / math.sqrt(len(seeds))
    else:
        return edges
    
    for i, seed1 in enumerate(seeds):
        u1, v1, pt1 = seed1
        
        # Find nearby seeds
        for j, seed2 in enumerate(seeds):
            if i >= j:  # Avoid duplicates
                continue
            
            u2, v2, pt2 = seed2
            
            # Check UV distance first (faster)
            uv_dist = math.sqrt((u1-u2)**2 + (v1-v2)**2)
            
            # Only consider if close in UV space
            if uv_dist < max(avg_u_spacing, avg_v_spacing) * max_distance_factor:
                # Calculate 3D distance
                dist_3d = pt1.DistanceTo(pt2)
                
                # Connect if reasonable neighbors
                edges.append(((u1, v1, pt1), (u2, v2, pt2)))
    
    return edges

def create_curve_on_surface(surf, pt1_uv, pt2_uv, steps=8):
    """Create a curve between two points following the surface"""
    u1, v1 = pt1_uv[0], pt1_uv[1]
    u2, v2 = pt2_uv[0], pt2_uv[1]
    
    points = []
    for i in range(steps + 1):
        t = i / float(steps)
        u = u1 + (u2 - u1) * t
        v = v1 + (v2 - v1) * t
        point = surf.PointAt(u, v)
        points.append(point)
    
    if len(points) > 1:
        return rg.Curve.CreateInterpolatedCurve(points, 3)
    return None

# Generate pattern based on type
if pattern_type == 0 or pattern_type == 2:
    # Generate Voronoi seed points
    print("Generating Voronoi seeds...")
    seeds = generate_voronoi_seeds_on_surface(target_surface, cell_density_u, cell_density_v)
    seed_points = [s[2] for s in seeds]
    
    print("Creating Voronoi edges...")
    edges = find_voronoi_neighbors(seeds, target_surface)
    
    # Create curves and pipes for Voronoi cell edges
    print(f"Creating {len(edges)} fiber geometries...")
    for seed1, seed2 in edges:
        curve = create_curve_on_surface(target_surface, seed1, seed2)
        
        if curve:
            pipe = rg.Brep.CreatePipe(curve, fiber_diameter/2, False, 
                                      rg.PipeCapMode.Round, True, 0.01, 0.01)
            if pipe:
                voronoi_fibers.extend(pipe)

# Add diagonal framework guides
if (pattern_type == 1 or pattern_type == 2) and include_framework:
    print("Creating diagonal framework...")
    
    diagonal_guides = int(diagonal_guides)
    u_domain = target_surface.Domain(0)
    v_domain = target_surface.Domain(1)
    
    num_steps = max(int(cell_density_v), 20)
    
    # Left diagonals (ascending)
    for diag in range(diagonal_guides):
        points = []
        
        for i in range(num_steps):
            t = i / float(num_steps - 1)
            
            # Move diagonally across UV space
            u = u_domain.Min + ((diag / float(diagonal_guides)) + t) % 1.0 * (u_domain.Max - u_domain.Min)
            v = v_domain.Min + t * (v_domain.Max - v_domain.Min)
            
            point = target_surface.PointAt(u, v)
            points.append(point)
        
        if len(points) > 1:
            curve = rg.Curve.CreateInterpolatedCurve(points, 3)
            if curve:
                pipe_radius = (fiber_diameter * framework_thickness) / 2
                pipe = rg.Brep.CreatePipe(curve, pipe_radius, False, 
                                          rg.PipeCapMode.Round, True, 0.01, 0.01)
                if pipe:
                    framework_fibers.extend(pipe)
    
    # Right diagonals (descending)
    for diag in range(diagonal_guides):
        points = []
        
        for i in range(num_steps):
            t = i / float(num_steps - 1)
            
            # Move diagonally in opposite direction
            u = u_domain.Min + ((diag / float(diagonal_guides)) - t) % 1.0 * (u_domain.Max - u_domain.Min)
            v = v_domain.Min + t * (v_domain.Max - v_domain.Min)
            
            point = target_surface.PointAt(u, v)
            points.append(point)
        
        if len(points) > 1:
            curve = rg.Curve.CreateInterpolatedCurve(points, 3)
            if curve:
                pipe_radius = (fiber_diameter * framework_thickness) / 2
                pipe = rg.Brep.CreatePipe(curve, pipe_radius, False, 
                                          rg.PipeCapMode.Round, True, 0.01, 0.01)
                if pipe:
                    framework_fibers.extend(pipe)

# Combine all geometry
all_fibers = voronoi_fibers + framework_fibers

# Output information
print("\nVenus Flower Basket Pattern Generated:")
print(f"  Pattern type: {['Voronoi only', 'Framework only', 'Combined'][pattern_type]}")
print(f"  Voronoi cell edges: {len(voronoi_fibers)}")
print(f"  Framework guides: {len(framework_fibers)}")
print(f"  Total elements: {len(all_fibers)}")
print(f"  Seed points: {len(seed_points)}")

# Assign outputs
a = all_fibers  # All combined geometry
b = voronoi_fibers  # Just Voronoi cells
c = framework_fibers  # Just diagonal framework
d = seed_points  # Seed points for visualization
# ---------- end py3_4 ----------
